# Dynamo custom node OTL_Create_objects_from_csv.dyf (Dynamo 3.4.1.7055)
# category: Civil3D_OTL_MOW_Toolkit
# Maak objecten uit een OTL conforme CSV als Civil3D objecten met data in de OTL propertysets. Gebruik hiervoor een dwg met OTL propertyset definitions.

OTL_CSV_file_or_folder = Input(OTL_CSV_file_or_folder: string = "")  # Geef het pad naar een CSV file met OTL data, of een folder met meerdere CSV files met OTL data
trans_OTL_csv_to_dict = Python(IN[0]=OTL_CSV_file_or_folder)  # CPython3
# ---------- trans_OTL_csv_to_dict.python (234 lines) ----------
# Load the Python Standard and DesignScript Libraries
import re
import os
import csv
import ctypes
import clr
import random


# Add Assemblies for AutoCAD and Civil3D
clr.AddReference('AcMgd')
clr.AddReference('AcCoreMgd')
clr.AddReference('AcDbMgd')
clr.AddReference('AecBaseMgd')
clr.AddReference('AecPropDataMgd')
clr.AddReference('AeccDbMgd')

# Import references from AutoCAD
from Autodesk.AutoCAD.Runtime import *
from Autodesk.AutoCAD.ApplicationServices import *
from Autodesk.AutoCAD.EditorInput import *
from Autodesk.AutoCAD.DatabaseServices import *
from Autodesk.AutoCAD.Geometry import *
from Autodesk.AutoCAD.Colors import *

# Import references from Civil3D
from Autodesk.Civil.ApplicationServices import *
from Autodesk.Civil.DatabaseServices import *

# Import references for PropertySets
from Autodesk.Aec.PropertyData import *
from Autodesk.Aec.PropertyData.DatabaseServices import *

# Import references for ListDefinitions
from Autodesk.Aec.DatabaseServices import ListDefinition, ListItem, DictionaryListDefinition

adoc = Application.DocumentManager.MdiActiveDocument
editor = adoc.Editor

#INPUT
CSVMap = IN[0]

foutgevonden = 0
message = ""
m = ctypes.windll.user32
nl = '\n'

def getCoo(wktstring):
    nums = re.findall(r'\d+(?:\.\d*)?', wktstring)
    coords = zip(*[iter(nums)] * 3)
    #strings uit tuple omzetten naar getallen in lijst
    coord_numbers = [] 
    for c in coords:
        x = float(c[0])
        y = float(c[1])
        z = float(c[2])
        coord_numbers.append([x,y,z])
    return list(coord_numbers)

def psetnaam(typeURI):
    """Maakt de unieke propertysetnaam voor een object"""
    objectsoort = typeURI.split('/')[-1].split('#')[0] #objectsoort afleiden uit typeURI
    objectnaam = typeURI.split('#')[1]
    propertysetnaam = "OTL_" + objectnaam
    return propertysetnaam
    
#DICTS maken uit CSVs
csv_dicts = []
filecount = 0

if CSVMap:
    if os.path.isdir(CSVMap):#bij folder
        for root, dirs, files in os.walk(CSVMap):
            for file in files:
                if file.endswith(".csv"):
                    filecount = filecount + 1
                    filedir= CSVMap + "\\" + file
                    with open(filedir, encoding='utf-8') as csvfile:
                        ingelezen_csv = csv.DictReader(csvfile, delimiter=";")
                        csv_dicts.append(list(ingelezen_csv))
        if filecount == 0:
            foutgevonden = 1
            if message == "":
                message = f"Kon geen CSV bestanden vinden in de folder: {nl}{str(CSVMap)}"
                
    if os.path.isfile(CSVMap):#bij file
        filedir = CSVMap
        if filedir.endswith(".csv"):
            filecount = filecount + 1
            with open(filedir, encoding='utf-8') as csvfile:
                ingelezen_csv = csv.DictReader(csvfile, delimiter=";")
                csv_dicts.append(list(ingelezen_csv))
        else:
            foutgevonden = 1
            if message == "":
                message = f"Opgegeven file is geen csv file: {nl}{str(CSVMap)}{nl}{nl}Geef een CSV file, of een folder met CSV files op"

else:
    foutgevonden = 1
    if message == "":
        message = f"Ongeldige input:{nl}{str(CSVMap)}{nl}{nl}Geef een CSV file, of een folder met CSV files op"


#Lege items skippen
lijstdictszonderlege = []
lijstdictszondergeom = []
OTLobjecten = 0
legacyobjecten = 0

for l in csv_dicts:
    for dict_a in l:
        #trailing .0 fix
        for sleutel, waarde in dict_a.items():
            if waarde.endswith(".0"):
                dict_a[sleutel] = waarde[:-2]        
    
        #enkel attributen met ingevulde waarde behouden in nieuwe dict
        res = {k: v for k, v in dict_a.items() if v}
        if "typeURI" in res:
            if ("//lgc.data") in res["typeURI"]: #check op legacy objecten
                legacyobjecten = legacyobjecten + 1
            else:            
                if "assetId.identificator" in res:
                    if "geometry" in res:
                        OTLobjecten = OTLobjecten + 1
                        lijstdictszonderlege.append(res) #enkel de objecten met een geometrie attribuut toevoegen aan resultaatlijst
                    else:
                        lijstdictszondergeom.append(res)

if OTLobjecten == 0:
    foutgevonden = 1
    if message == "":
        message = f"GEEN objecten aangemaakt in dwg: Kon geen OTL objecten met geometrie vinden in de CSV bestanden in de folder: {nl}{str(CSVMap)}"                        

if OTLobjecten > 2000:
    veelobjectenmsg = "Er worden meer dan 2000 objecten verwerkt, dit kan even tijd in beslag nemen.."
    m.MessageBoxW(0, str(veelobjectenmsg), "OTL objecten uit CSV omzetting", 0)

if legacyobjecten > 0:
    lgcmsg = "Enkel OTL objecten kunnen verwerkt worden, De legacy objecten uit de CSVs worden GENEGEERD. Aantal legacy objecten: " + str(legacyobjecten)
    m.MessageBoxW(0, str(lgcmsg), "OTL objecten uit CSV omzetting", 0)
    
if lijstdictszondergeom:
    nogeomtypes = set([psetnaam(d['typeURI']) for d in lijstdictszondergeom])
    nogeommsg = f"De OTL objecten ZONDER geometrie (zoals oa relaties) worden GENEGEERD. Aantal objecten zonder geometrie: {len(lijstdictszondergeom)} {nl}Van volgende types:{nl}{nl}{nl.join(nogeomtypes)}"
    m.MessageBoxW(0, str(nogeommsg), "OTL objecten uit CSV omzetting", 0)
    
ongevonden_psets = []
puntobjecten = []
lijnobjecten = []
single_polygoonobjecten = []
donut_polygoonobjecten = []
geofouten = []

#PROPERTSET DEFINITIONS CHECKEN
with adoc.LockDocument():
    with adoc.Database as db:
        with db.TransactionManager.StartTransaction() as t:
            dpsd = DictionaryPropertySetDefinitions(db)
            for dict_y in lijstdictszonderlege:
                #controle of propertysetnaam  bestaat in de huidige dwg
                propertysetnaam = psetnaam(dict_y['typeURI'])   
                if not dpsd.Has(propertysetnaam, t): #propertysetnaam bestaat nog niet
                    if propertysetnaam not in ongevonden_psets: #maar 1 keer toevoegen
                        ongevonden_psets.append(propertysetnaam)


# LAYERS AANMAKEN
with adoc.LockDocument():
    with adoc.Database as db:
        with db.TransactionManager.StartTransaction() as t:
            layertable = t.GetObject(db.LayerTableId,OpenMode.ForRead)
            for dict_y in lijstdictszonderlege:
                layernaam = f"FromCSV_{psetnaam(dict_y['typeURI'])}" #de naam van de layer afleiden uit typeURI
                if not layertable.Has(layernaam):
                    newlayer = LayerTableRecord()
                    newlayer.Name = layernaam
                    newlayer.Color = Color.FromColorIndex(ColorMethod.ByAci, random.randint(1, 249))
                    layertable = t.GetObject(db.LayerTableId,OpenMode.ForWrite)
                    layertable.Add(newlayer)
                    t.AddNewlyCreatedDBObject(newlayer, True)
            t.Commit()


if len(ongevonden_psets) == 0: #bij alles gevonden
    if message == "":
        gevonden_types = set([psetnaam(d['typeURI']) for d in lijstdictszonderlege])
        message = f"De nodige OTL Propertysetdefinitions werden gevonden in de dwg:{nl}{nl}{nl.join(gevonden_types)}"
    for dict_b in lijstdictszonderlege:
    #opsplitsing maken per mogelijk geotype
        dict_b["psetnaam"] = psetnaam(dict_b['typeURI']) #psetnaam toevoegen
        if dict_b['geometry'].startswith("POINT Z"):
            dict_b["coordinates"] = getCoo(dict_b['geometry'])
            puntobjecten.append(dict_b)
        elif dict_b['geometry'].startswith("LINESTRING Z"):
            dict_b["coordinates"] = getCoo(dict_b['geometry'])
            lijnobjecten.append(dict_b)
        elif dict_b['geometry'].startswith("POLYGON Z"):
            donutsplit = dict_b['geometry'].split('),(')
            if len(donutsplit) == 1:
                dict_b["coordinates"] = getCoo(dict_b['geometry'])
                single_polygoonobjecten.append(dict_b)
            else:
                donutcoolist = []
                for polygon in donutsplit:
                    donutcoolist.append(getCoo(polygon))
                dict_b["coordinates"] = donutcoolist
                donut_polygoonobjecten.append(dict_b)
        else:
            #onverwerkbaar geotype
            geofouten.append(f'{nl}assetId: {dict_b["assetId.identificator"]}{nl}type: {psetnaam(dict_b["typeURI"])}{nl}wkt: {dict_b["geometry"][:30]}...')
    
    if len(geofouten) > 0:
        if len(geofouten) < 5:
            geofoutmessage = f'Volgende objecten werden NIET toegevoegd vanwegen een ongeldig WKT geometrietype:{nl}{nl.join(geofouten)}'
        else:
            geofoutmessage = f'Meerdere objecten werden NIET toegevoegd vanwegen een ongeldig WKT geometrietype, waaronder:{nl}{nl.join(geofouten)}{nl}En meer..'            
        m.MessageBoxW(0, str(geofoutmessage), "OTL objecten uit CSV omzetting", 0)

else:
   foutgevonden = 1
   if message == "":
        message = f"Kon objecten niet aanmaken omdat de nodige propertysetdefinitie niet bestaat in de dwg. Voeg volgende propertysetdefinities toe: {nl}{nl}{nl.join(ongevonden_psets)}"   


m.MessageBoxW(0, str(message), "OTL objecten uit CSV omzetting", 0)

# OUT variable.

if foutgevonden == 1:
    OUT = [[],[],[],[]]
else:   
    OUT = [puntobjecten,lijnobjecten,single_polygoonobjecten,donut_polygoonobjecten]
    
# ----------------------------------------

# group: Puntobjecten
code_block = CodeBlock { 0; }
getItemAtIndex = List.GetItemAtIndex(list=trans_OTL_csv_to_dict, index=code_block)

# group: coo to points
code_block_2 = CodeBlock(t1=getItemAtIndex)
# ---------- code_block_2.designscript (5 lines) ----------
coo = Dictionary.ValueAtKey(t1, "coordinates");
id = Dictionary.ValueAtKey(t1, "assetId.identificator");
uri = Dictionary.ValueAtKey(t1, "typeURI");
pset = Dictionary.ValueAtKey(t1, "psetnaam");
layernaam = "FromCSV_" + pset;
# ----------------------------------------
code_block_3 = CodeBlock(l=code_block_2.coo) { DSCore.List.GetItemAtIndex(l@L2<1>,0); DSCore.List.GetItemAtIndex(l@L2<1>,1); DSCore.List.GetItemAtIndex(l@L2<1>,2); }
byCoordinates = Point.ByCoordinates(x=code_block_3.out0, y=code_block_3.out1, z=code_block_3.out2)

# group: info over current doc
current = Autodesk.AutoCAD.DynamoNodes.Document.Current()
modelSpace = Autodesk.AutoCAD.DynamoNodes.Document.ModelSpace(document=current)

byGeometry = Autodesk.Civil.DynamoNodes.CogoPoint.ByGeometry(point=byCoordinates, layerName=code_block_2.layernaam, document=current, name=code_block_2.id)

# group: lijnobjecten
code_block_4 = CodeBlock { 1; }
getItemAtIndex_2 = List.GetItemAtIndex(list=trans_OTL_csv_to_dict, index=code_block_4)

# group: polygoonobjecten
code_block_5 = CodeBlock { 2; }
getItemAtIndex_3 = List.GetItemAtIndex(list=trans_OTL_csv_to_dict, index=code_block_5)

join = List.Join(list0=getItemAtIndex_2, list1=getItemAtIndex_3)

# group: coo to points
code_block_6 = CodeBlock(t1=join)  # same code as code_block_2
code_block_7 = CodeBlock(l=code_block_6.coo)
# ---------- code_block_7.designscript (3 lines) ----------
x = DSCore.List.GetItemAtIndex(l@L2<1>,0);
y = DSCore.List.GetItemAtIndex(l@L2<1>,1);
z = DSCore.List.GetItemAtIndex(l@L2<1>,2);
# ----------------------------------------
byCoordinates_2 = Point.ByCoordinates(x=code_block_7.x, y=code_block_7.y, z=code_block_7.z)

# group: puntobjecten hergroeperen
code_block_8 = CodeBlock(t1=code_block_6.coo, point1=byCoordinates_2) { num1 = List.Count(t1@L3<1>); t2 = List.Chop(point1, num1); }

byPoints = Autodesk.AutoCAD.DynamoNodes.Polyline3D.ByPoints(points=code_block_8.t2, layerName=code_block_6.layernaam, block=modelSpace)

# group: donut-polygoonobjecten
code_block_9 = CodeBlock { 3; }
getItemAtIndex_4 = List.GetItemAtIndex(list=trans_OTL_csv_to_dict, index=code_block_9)

# group: coo to points
code_block_10 = CodeBlock(t1=getItemAtIndex_4)  # same code as code_block_2
code_block_11 = CodeBlock(l=code_block_10.coo)  # same code as code_block_7
byCoordinates_3 = Point.ByCoordinates(x=code_block_11.x, y=code_block_11.y, z=code_block_11.z)

# group: puntobjecten hergroeperen
code_block_12 = CodeBlock(t1=code_block_10.coo, point1=byCoordinates_3) { num1 = List.Count(t1@L3<1>); num2 = List.Count(t1@L4<1>); t2 = List.Chop(point1, num1); t3 = List.Chop(t2, num2); }

ofRepeatedItem = List.OfRepeatedItem(item=code_block_10.layernaam@L1, amount=code_block_12.num2, lacing=Shortest)
byPoints_2 = Autodesk.AutoCAD.DynamoNodes.Polyline3D.ByPoints(points=code_block_12.t3, layerName=ofRepeatedItem, block=modelSpace)

# group: opvallende kleur voor donut polygons
generate_colorcodes = Python(IN[0]=byPoints_2)  # CPython3
# ---------- generate_colorcodes.python (14 lines) ----------
import random

objectenlijst = IN[0]

kleurenlijst = []
for o in objectenlijst:
    donutlijst = []
    kleurcode = {'r':random.randint(1, 249),'g':random.randint(1, 249),'b':random.randint(1, 249)}

    for d in o:
        donutlijst.append(kleurcode)
    kleurenlijst.append(donutlijst)

OUT = kleurenlijst
# ----------------------------------------
code_block_13 = CodeBlock(rgb=generate_colorcodes) { color1 = Color.ByARGB(255, rgb['r'], rgb['g'], rgb['b']); }
setColor = Autodesk.AutoCAD.DynamoNodes.Object.SetColor(object=byPoints_2, color=code_block_13)

# group: data dupliceren voor donuts
flatten = List.Flatten(list=setColor)
ofRepeatedItem_2 = List.OfRepeatedItem(item=getItemAtIndex_4@L1, amount=code_block_12.num2, lacing=Shortest)
flatten_2 = List.Flatten(list=ofRepeatedItem_2)

# group: Objecten
join_2 = List.Join(list0=byGeometry, list1=byPoints, list2=flatten)

# group: data
join_3 = List.Join(list0=getItemAtIndex, list1=join, list2=flatten_2)

# group: Data toevoegen
python_script = Python(IN[0]=join_2, IN[1]=join_3)  # CPython3
# ---------- python_script.python (222 lines) ----------
# Importeer de benodigde modules
import clr
import ctypes

clr.AddReference('AcMgd')
clr.AddReference('AcDbMgd')
clr.AddReference('AecBaseMgd')
clr.AddReference('AecPropDataMgd')
clr.AddReference('AeccDbMgd')

from Autodesk.Civil.DatabaseServices import *
from Autodesk.AutoCAD.DatabaseServices import *
from Autodesk.AutoCAD.ApplicationServices import *
from Autodesk.Civil.Runtime import *
from Autodesk.Aec.PropertyData.DatabaseServices import *
from Autodesk.Aec.DatabaseServices import ListDefinition, ListItem, DictionaryListDefinition

m = ctypes.windll.user32

geometrieobjecten = IN[0] #(lijst van Dynamo geometrie objecten)
OTL_datadict = IN[1] #lijst van dictionaries met OTL data, bijv. "psetnaam" en andere eigenschappen

        
# Haal het actieve document en de database op
adoc = Application.DocumentManager.MdiActiveDocument
db = adoc.Database
editor = adoc.Editor

# Lijst om de ID's van de output in op te slaan
nl = '\n'

#Functies
def remove_nonOTL_keys(OTL_datadict):
    """niet otl data verwijderen uit dict"""
    for d in OTL_datadict:
        del d["coordinates"]
        del d["geometry"]
    return OTL_datadict
    
def koppel_OTLdata_aan_objecten(geometrieobjecten,OTL_datadict):
    """koppel de OTL data aan de aangemaakte geometrie-objecten"""    
    eindlijst = []
    messagelist = []
    success_count = 0
    prop_count = 0
    ontbrekende_prop = 0
    foutekeyvaluelijst = []
    toegevoegdeKLopties = []
    
    with db.TransactionManager.StartTransaction() as tr:
        try:
            # Haal de PropertySetDefinitionManager op
            dpsd = DictionaryPropertySetDefinitions(db)
            dld = DictionaryListDefinition(db)
            
            # Loop door elk object en de bijbehorende data
            for i, obj in enumerate(geometrieobjecten):
                # Haal de data op die hoort bij het huidige object
                if i >= len(OTL_datadict):
                    message = "FOUT: Onvoldoende data in OTL_datadict voor alle objecten."
                    messagelist.append(message)
                    break
                
                OTLdata = OTL_datadict[i]
                psetnaam = OTLdata.get("psetnaam")
                
                if psetnaam is None:
                    message = f"FOUT: Geen 'psetnaam' gevonden voor object {i}."
                    messagelist.append(message)
                    continue
    
                # Zoek de PropertySetDefinition op
                psdefid = dpsd.GetAt(psetnaam)
                psdef = tr.GetObject(psdefid, OpenMode.ForRead)
                propertydefinitions = psdef.Definitions
                
                if psdefid.IsNull:
                    message = f"FOUT: PropertySetDefinition {psetnaam} niet gevonden."
                    messagelist.append(message)
                    continue
    
                # haal id uit dynamo object
                try:
                    h = obj.Handle
                    ObjId = obj.InternalObjectId
                    aeccObj = tr.GetObject(ObjId, OpenMode.ForWrite)    
    
                except Exception as e:
                    message = f"FOUT: Ongeldige object met handle {h}: {str(e)}"
                    messagelist.append(message)
                    continue
                
                if aeccObj:
                    # Koppel de PropertySet aan het Civil 3D object
                    PropertyDataServices.AddPropertySet(aeccObj, psdefid)                                 
                    # Haal de gekoppelde pset op voor dit object
                    propertyset = PropertyDataServices.GetPropertySet(aeccObj, psdefid)
                    psetn = propertyset.Open(OpenMode.ForWrite)
                    propertysetnaam = psetn.PropertySetDefinitionName
                    psetdatacoll = psetn.PropertySetData
                        
                    if psetdatacoll is not None:
                        # Loop door de dictionary en stel de waarden in
                        for propNaam, value in OTLdata.items():
                            # Sla 'psetnaam' over, deze is al verwerkt
                            if propNaam == "psetnaam":
                                continue
                            # Sla lege waarden over
                            if not value:
                                continue
                            # Stel default lege waarde in
                            convertvalue = ""
                            
                            # Kijk of property bestaat
                            try:
                                propId = psetn.PropertyNameToId(propNaam)
                            except Exception as e:
                                ontbrekende_prop += 1
                                if [psetnaam,propNaam,"property ontbreekt"] not in foutekeyvaluelijst: 
                                    foutekeyvaluelijst.append([psetnaam,propNaam,"property ontbreekt"])
                                continue
                                
                            try:
                                prop = psetdatacoll[propId]
                                propType = prop.DataType
                                #waarde omzetten obv datatype van property in propertyset
                                if propType == 0:
                                    #integer
                                    convertvalue = int(value)
                                elif propType == 1:
                                    #getal
                                    convertvalue = float(value)
                                elif propType == 6:
                                    #keuzelijst
                                    if value == "":
                                        convertvalue = "-"
                                    elif value == "true":
                                        convertvalue = "True"
                                    elif value == "false":
                                        convertvalue = "False"
                                    elif value == True:
                                        convertvalue = "True"
                                    elif value == False:
                                        convertvalue = "False"
                                    else: 
                                        convertvalue = str(value)
    
    
                                    #haal de mogelijke keuzes op uit de listdefinitie
                                    #als de keuzelijstoptie niet bestaat, creer een nieuwe
                                    propdef = propertydefinitions[propId]
                                    ldefid = propdef.ListDefinitionId
                                    #open de lijstdefinitie en voeg toe indien nodig
                                    ld = tr.GetObject(ldefid, OpenMode.ForWrite)
                                    first = True                               
                                    for oid in ld.GetListItems(): #loop door de keuzelijstopties
                                        li = tr.GetObject(oid, OpenMode.ForRead)
                                        if li.Name == convertvalue:
                                            first = False
                                            break
                                    if first: #Als de opties niet bestaat, maak een nieuwe aan
                                        if convertvalue:
                                            if [psetnaam,propNaam,convertvalue] not in toegevoegdeKLopties:
                                                toegevoegdeKLopties.append([psetnaam,propNaam,convertvalue])
                                                ld.AddListItem(value)
                                    
                                else:
                                    convertvalue = str(value)
                                    
                                #Value invullen
                                prop.SetData(convertvalue)
                                prop_count += 1
                                
                            except Exception as e:
                                if [psetnaam,value,propNaam,"Ongeldige waarde"] not in foutekeyvaluelijst:
                                    foutekeyvaluelijst.append([psetnaam,value,propNaam,"Ongeldige waarde"])
                                continue
                    
                    eindlijst.append(obj)
                    success_count += 1
                    
            if toegevoegdeKLopties:
                printableklo = nl.join([str(ele) for ele in toegevoegdeKLopties])
                m.MessageBoxW(0, f"Volgende keuzelijstopties werden toegevoegd: {nl}{printableklo}", "KeuzelijstOpties toegevoegd", 0)
                
            if foutekeyvaluelijst:
                printablekvl = nl.join([str(ele) for ele in foutekeyvaluelijst])
                if ontbrekende_prop:
                    message = f"Volgende attributen konden NIET worden ingevuld, {nl}kijk na of deze bestaan in de propertyset definities:{nl}{nl}{printablekvl}"
                else:
                    message = f"Volgende attributen konden NIET worden ingevuld:{nl}{nl}{printablekvl}"
                messagelist.append(message)
                
            if success_count > 0:
                message = f"{nl}TAAK VOLTOOID. {success_count} objecten aangemaakt en {prop_count} properties ingevuld."
                messagelist.append(message)                
                    
        except Exception as ex:
            message = f"Er is een FOUT opgetreden: {str(ex)}"
            messagelist.append(message)
    
        tr.Commit()
        return messagelist,eindlijst

    
#Uitvoeren
if len(geometrieobjecten) > 0 and len(OTL_datadict) > 0:
    OTL_datadict = remove_nonOTL_keys(OTL_datadict)
    messagelist,eindlijst = koppel_OTLdata_aan_objecten(geometrieobjecten,OTL_datadict)
    if messagelist:
        m.MessageBoxW(0, str(nl.join(messagelist)), "OTL attributen invullen", 0)

elif OTL_datadict and not geometrieobjecten:
    #indien geen geometrieobjecten
    m.MessageBoxW(0, "GEEN objecten aangemaakt", "OTL attributen invullen", 0)
    eindlijst = "GEEN objecten aangemaakt"

else:
    eindlijst = "GEEN OTL data gevonden en GEEN objecten aangemaakt"

# Wijs de output toe aan de OUT variabele
OUT = eindlijst
# ----------------------------------------

Aangemaakte_Objecten = Output(python_script)  # Aangemaakte dwg objecten met OTL data
