# Dynamo custom node OTL_Create_propertset_definitions.dyf (Dynamo 3.6.1.9956)
# category: Civil3D_OTL_MOW_Toolkit
# Methode om vanuit een OTL subset property set definitions aan te maken in een dwg. Download en gebruikt hiervoor de Python OTLMOW libraries. Bruikbaar in dynamo 3.0 (vanaf civil3D 2025)

# group: Inputs
Library_Download = Input(Library_Download: bool = True)  # Bij 'true' worden de OTLMOW libraries (opnieuw) gedownload naar de OTL_libraries_folder
OTL_libraries_folder = Input(OTL_libraries_folder: string = "")  # Folder waar de OTLMOW library opgeslagen mag worden. Bij geen input zal de folder waarin de dwg staat worden gebruikt.
OTL_SUBSET = Input(OTL_SUBSET: string = "")  # pad naar OTL subset db in sqlite
Attribuut_filter = Input(Attribuut_filter: bool = True)  # Bij 'True' worden enkel de attributen uit de susbet aangemaakt, bij 'False' alle OTL attributen voor de klasses in de subset

# group: OTL_create_propertyset_definitions
check_input_folders_and_db = Python(IN[0]=Library_Download, IN[1]=OTL_libraries_folder, IN[2]=OTL_SUBSET, IN[3]=Attribuut_filter)  # CPython3
# ---------- check_input_folders_and_db.python (131 lines) ----------
# Load the Python Standard and DesignScript Libraries
import os.path
import ctypes
import sqlite3

from Autodesk.AutoCAD.ApplicationServices import *

# The inputs to this node will be stored as a list in the IN variables.
toolkit_update = IN[0]
inputpad = IN[1]
subset_db = IN[2]
subset_filter = IN[3]

# Main variables
nl = "\n"

# Functies
def downloadfolder_in_dwg_folder():
    """Haal de foldernaam van de huidge dwg file op"""
    try:
        adoc = Application.DocumentManager.MdiActiveDocument
        editor = adoc.Editor
        with adoc.LockDocument():
            with adoc.Database as db:
                dwg_filepath = db.OriginalFileName
                filepath = dwg_filepath.rsplit('\\',1)[0]#filenaam weglaten
        
        
        if filepath.endswith(r'enu\Template'):
            downloadfolder = "dwg templade folder"
        else:
            downloadfolder = filepath + r'\OTLmodelDownload'
            if not os.path.isdir(downloadfolder):
                os.mkdir(downloadfolder)
        
    except:
        downloadfolder = "ongeldig pad"
    
    return downloadfolder

def check_pad_geldigheid(pad):
    """kijkt of het pad naar een bruikbare folder wijst"""
    message = ""
    if isinstance(pad, str):
        if not os.path.isdir(pad):
            message = f"{pad}{nl}Kan NIET worden gebruikt om de OTLMOW libraries op te slaan:{nl}Geef een ander pad op aub"
            pad = "ongeldig_pad"
    else:
        message = f"{pad}{nl} kan NIET worden gebruikt om de OTLMOW libraries op te slaan:{nl}Geef het pad op aub"
        pad = "ongeldig_pad"

    return pad,message

def doelpad_opzoeken(user_input_path):
    """Zoekt het juiste pad om de OTLMOW library naar te downloaden en op te slaan"""
    if user_input_path and user_input_path != "null" and user_input_path != "":
        #Er werd een pad opgegeven door de user
        doelpad, foldermessage = check_pad_geldigheid(user_input_path)       
    else:
        doelpad, foldermessage = check_pad_geldigheid(downloadfolder_in_dwg_folder())
    return doelpad,foldermessage

def create_connection(db_file):
    """ maak connectie naar de SQLite database"""
    conn = None
    try:
        conn = sqlite3.connect(db_file)
    except Error as e:
        print(e)
    return conn


def select_klasses(conn):
    """klasses uit sqlite ophalen"""
    conn = create_connection(conn)
    klasses_in_subset = []
    with conn:
        cur = conn.cursor()
        cur.execute("SELECT name FROM sqlite_master WHERE type='table' AND name='OSLOClass';")
        bestaat_klassetabel = cur.fetchall()
        if bestaat_klassetabel:
            cur.execute("SELECT uri FROM OSLOClass WHERE abstract = '0';")
            klasses_in_subset = cur.fetchall()
            klasses_in_subset = klasses_in_subset[0]
    return klasses_in_subset

def check_subset_geldigheid(db_pad):
    """Kijkt na of de input een geldige OTL db is"""
    geldige_db_pad = ""
    message = ""
    if isinstance(db_pad, str):
        if os.path.exists(db_pad) and db_pad:
            extensie = db_pad.split(".")[-1]
            if extensie == "db":
                geldige_db_pad = db_pad
                #message = f"Geldige subset input:{nl}{db_pad}"
            else:
                message = f"ONGELDIGE subset input: Bestand is geen .db bestand:{nl}{db_pad}"
        else:
            message = f"ONGELDIGE subset input: bestand is geen geldige subset gevonden:{nl}{db_pad}"
    else:
        message = f"ONGELDIGE subset input: bestand kon niet worden gevonden:{nl}{db_pad}"

    if geldige_db_pad:
        onderdelen = select_klasses(geldige_db_pad)
        if len(onderdelen) == 0:
            message = f"ONGELDIGE subset input: Geen OTL klassen gevonden in db file:{nl}{db_pad}"
            geldige_db_pad = ""

    return geldige_db_pad,message


# MAIN
doelpad, foldermessage = doelpad_opzoeken(inputpad)
subsetpad, subsetmessage = check_subset_geldigheid(subset_db)

# Enkel bij probleem pop-up geven
if foldermessage and subsetmessage:
    endmessage = f"{foldermessage}{nl}{nl}{subsetmessage}"
elif foldermessage:
    endmessage = foldermessage
elif subsetmessage:
    endmessage = subsetmessage
else:
    endmessage = ""

if endmessage:
    ctypes.windll.user32.MessageBoxW(0, endmessage, "OTL_propertysetdefinitions_aanmaken", 0)

# OUT variable
OUT = doelpad,subsetpad,subset_filter,toolkit_update
# ----------------------------------------
code_block = CodeBlock(out=check_input_folders_and_db) { doelpad = out[0]; subsetpad = out[1]; subset_filter = out[2]; toolkit_update = out[3]; }
otlmow_library_inladen = Python(IN[0]=code_block.doelpad, IN[1]=code_block.subsetpad, IN[2]=code_block.subset_filter, IN[3]=code_block.toolkit_update)  # CPython3
# ---------- otlmow_library_inladen.python (117 lines) ----------
import urllib.request
import sys
from zipfile import ZipFile
import os.path
import ctypes


#DE JUISTE FOLDERS OPHALEN VIA INPUT
doelpad = IN[0]
subsetpad = IN[1]
subset_filter = IN[2]
toolkit_update = IN[3]

nl = '\n'


#FUNCTIE VOOR AFLADEN MODULES
def moduleDownloadenViaZiplink(naam,link,doelpad):
    """Gebruikt een Github link om python modules af te laden en bruikbaar te maken"""
    ziplocatie = f'{doelpad}\\{naam}.zip'

    try:
        urllib.request.urlretrieve(link,ziplocatie)
        with ZipFile(ziplocatie, 'r') as zObject: 
            zObject.extractall(path=doelpad)
            message = f'Download van {naam} geslaagd'
        if not os.path.isdir(doelpad): #kijken of de folder bestaat
            message = f'FOUT in downloaden of unzippen van {naam} python library'
    except:
        message = f'FOUT in downloaden of unzippen van {naam} python library'

    return message
                  
#FUNCTIE VOOR MODULE TOEVOEGEN AAN PATH
def moduleToevoegenAanPath(modulefolder,naam):
    if os.path.isdir(modulefolder): #kijken of de folder bestaat
        if os.path.isdir(modulefolder + r'/otlmow_model'): #kijken of de otl model in de folder staat

            if modulefolder in sys.path:
                sys.path.remove(modulefolder) #Verwijderen om opniew te kunnen inladen, bv na nieuwe download

            try:
                sys.path.insert(0, modulefolder)
                #message = f'Toevoegen van {naam} aan PATH geslaagd'
                message = ""
    
            except:
                message = f'FOUT in toevoegen van {naam} python library'

        else:
            message = f'De OTL library werd niet gevonden in de folder {modulefolder}, mogelijk zijn ze nog niet gedownload'
   
    else:
        message = f'FOUT in toevoegen van python libraries, folder {modulefolder} bestaat niet'
    
    return message


def checkOTLmodules(message):
    """controleer of de modules correct zijn ingeladen"""
    try:
        from otlmow_model.OtlmowModel.Classes.ImplementatieElement import AIMObject
        from otlmow_converter.DotnotationDictConverter import DotnotationDictConverter
        
        finalmessage = f"{nl}OTL modules en libraries zijn succesvol ingeladen{nl}{message}"
        go = 1

    except Exception as e:
        go = 0
        # Controleer of de gebruikte python versie lager is dan 3.9
        MIN_MAJOR = 3
        MIN_MINOR = 9
        current_major = sys.version_info.major
        current_minor = sys.version_info.minor

        if current_major < MIN_MAJOR or (current_major == MIN_MAJOR and current_minor < MIN_MINOR):
            finalmessage = f"{nl}FOUT bij inladen OTL modules en libraries:{nl}De gebruikte python versie ({current_major}.{current_minor}) is te laag {nl}Minimum vereist = 3.9{nl}Probeer een recentere versie van Dynamo voor Civil3D, bv. 2025 of nieuwer"
    
        else:
            finalmessage = f"{nl}FOUT bij inladen OTL modules en libraries:{nl}{message}{nl}fout:{e}{nl}{nl}Herstart civil3D en Dynamo indien deze fout zich blijft voordoen."

    return finalmessage,go
    

def getOTLmodules(doelpad,downloadcheck):
    """referentie welke modules waar opgehaald moeten worden. Toevoeging aan het python Path en testing"""

    message = ""
    if downloadcheck: #voor het geval de libs gedownload moeten worden
        #OTLMOW MODEL
        naam = "otlmow_model"
        githublink = r'https://raw.githubusercontent.com/davidvlaminck/OTLMOW-Model/refs/heads/master/source.zip'
        message = message + "\n" + moduleDownloadenViaZiplink(str(naam),githublink,doelpad)
        
        #OTLMOW CONVERTER
        naam = "otlmow_converter"
        githublink = r'https://raw.githubusercontent.com/davidvlaminck/OTLMOW-Converter/refs/heads/master/source.zip'
        message = message + "\n" + moduleDownloadenViaZiplink(str(naam),githublink,doelpad)

    #PAD TOEVOEGEN
    message = message + "\n" + "\n" + moduleToevoegenAanPath(doelpad,"OTL modules en libraries")
    
    #CHECK OF MODULES WERKEN
    outputmessage,go = checkOTLmodules(message)

    return outputmessage,go

#UITVOEREN
if doelpad and doelpad != "ongeldig_pad":
    outputmessage, go = getOTLmodules(doelpad,toolkit_update)
    if outputmessage:
        ctypes.windll.user32.MessageBoxW(0, outputmessage, "Inladen OTLMOW libraries", 0)

else:
    go = 0

OUT = [doelpad,subsetpad,subset_filter,go]
# ----------------------------------------
code_block_2 = CodeBlock(out=otlmow_library_inladen) { doelpad = out[0]; subsetpad = out[1]; subset_filter = out[2]; go = out[3]; }
otldata_to_dict = Python(IN[0]=code_block_2.doelpad, IN[1]=code_block_2.subsetpad, IN[2]=code_block_2.subset_filter, IN[3]=code_block_2.go)  # CPython3
# ---------- otldata_to_dict.python (273 lines) ----------
import importlib
import sqlite3
from sqlite3 import Error
from os.path import exists
import ctypes

#FUNCTIES
def create_connection(db_file):
        """ maak connectie naar de SQLite database"""
        conn = None
        try:
            conn = sqlite3.connect(db_file)
        except Error as e:
            ctypes.windll.user32.MessageBoxW(0, str(e), "SQlite lezen gefaald", 0)
        return conn
    
    
def select_klasses(conn):
    """klasses uit sqlite ophalen"""
    conn = create_connection(conn)
    with conn:
        cur = conn.cursor()
        #klassen selecteren en daarbij abstracten, agents,bijlagen en relaties weglaten
        cur.execute("""
             SELECT k.uri FROM OSLOClass k 
                WHERE abstract = '0' 
                AND name NOT LIKE 'Agent' 
                AND name NOT LIKE 'Bijlage' 
                AND uri NOT LIKE 'https://wegenenverkeer.data.vlaanderen.be/ns/proefenmeting#%'
                AND k.uri NOT IN (
                SELECT DISTINCT uri
                FROM OSLORelaties
                );""")
        klasses_onderdelen_tuple = cur.fetchall()
        klasses_onderdelen = []
        for k in klasses_onderdelen_tuple:
            klasses_onderdelen.append(k[0])

        if len(klasses_onderdelen) > 100:
            ctypes.windll.user32.MessageBoxW(0, "Verwerking van meer dan 100 OTL types, dit kan enkele minuten duren..", "Inlezen OTL SQLite", 0)

    return(klasses_onderdelen)

def select_attributen(conn, klasse_uri):
    """attributen voor klasse uit SQlite halen"""
    conn = create_connection(conn)
    with conn:
        cur = conn.cursor()
        #attributen voor bepaalde klasse ophalen
        cur.execute("""
                    SELECT a.name FROM OSLOAttributen a
                    WHERE class_uri = ?
                    """, (klasse_uri,))
        attributen_tuple = cur.fetchall()
        attributen = []
        for attr in attributen_tuple:
            attributen.append(attr[0])
    return(attributen)


def dummydict():
    onderdeeldict = {} #een dict om alle info voor een bepaalde propertyset in te verzamelen
    
    onderdeeldict["propertysetnaam"] = "OTL_dummy"
    onderdeeldict["definitie"] = "Een dummy object"
    onderdeeldict["typeURI"] = "dummyURI"
    onderdeeldict["attributen"] = []
    
    attribuutdict = {} # een dict per dotnotatie-attribuut
    
    attribuutdict["dotnotatie_attribuutnaam"] = "dummy.attribuut"
    attribuutdict["attribuutdefinitie"] = "Een dummy attribuut"
    attribuutdict["datatype_attribuut"] = 'keuzelijst'
    attribuutdict["default_value"] = '-'
    attribuutdict["keuzelijstopties"] = ['dummywaarde-A','dummywaarde-B','-']
    attribuutdict["keuzelijstnaam"] = 'dummy-lijst'
    
    onderdeeldict["attributen"].append(attribuutdict) #Voeg de attribuutinfo toe aan de dict voor dit onderdeel
    return onderdeeldict


def attribute_info_to_dict(obj, attribute):
    """verzamelt de info van het attribuut (in dotnatatie) in een dict"""

    attribuutdict = {} # een dict per dotnotatie-attribuut

    #SPECIALE ATTRIBUTEN
    if attribute == "typeURI": #kan geen attr ophalen voor typeURI
        #attr = getattr(obj,"_typeURI")
        attribuutdict["attribuutdefinitie"] = "De URI van het object"
        attribuutdict["datatype_attribuut"] = "Text"
        attribuutdict["default_value"] = obj.typeURI
        attribuutdict["dotnotatie_attribuutnaam"] = attribute

    elif attribute == "geometry": 
        attribuutdict = {} #Geometrie attribuut niet nodig in civil3D, 

    #NORMALE ATTRIBUTEN
    else:
        #ATTRIBUUTNAAM
        attribuutdict["dotnotatie_attribuutnaam"] = attribute
        attr = DotnotationHelper.get_attribute_by_dotnotation(obj,attribute,waarde_shortcut=False) #haalt het attribuut-object op
        attr_ws = DotnotationHelper.get_attribute_by_dotnotation(obj,attribute,waarde_shortcut=True)

        #DEFINTIE
        attribuutdict["attribuutdefinitie"] = (attr.definition[:250] + '..') if len(attr.definition) > 250 else attr.definition
        
        #DATATYPE & DEFAULT VALUE(civil3D datatypes)
        if attr_ws.field:
            OTL_datatype = attr_ws.field
        
            if OTL_datatype.naam == "String":
                attribuutdict["datatype_attribuut"] = "Text"
                attribuutdict["default_value"] = ""
            elif OTL_datatype.naam == "Decimal":
                attribuutdict["datatype_attribuut"] = "Real"
                attribuutdict["default_value"] = -999999999.000000
            elif OTL_datatype.naam == "Date":
                attribuutdict["datatype_attribuut"] = "Text"
                attribuutdict["default_value"] = ""
            elif OTL_datatype.naam == "AnyURI":
                attribuutdict["datatype_attribuut"] = "Text"
                attribuutdict["default_value"] = ""
            elif OTL_datatype.naam == "NonNegativeInteger" or OTL_datatype.naam == "Integer": 
                attribuutdict["datatype_attribuut"] = "Integer"
                attribuutdict["default_value"] = -999999999
            elif OTL_datatype.naam == "Boolean":
                if attribute == "isActief":
                    attribuutdict["datatype_attribuut"] = 'keuzelijst'
                    attribuutdict["default_value"] = 'True'
                    attribuutdict["keuzelijstopties"] = ['True','False','-']
                    attribuutdict["keuzelijstnaam"] = 'booleanlijst-true-default'
                else:
                    attribuutdict["datatype_attribuut"] = 'keuzelijst'
                    attribuutdict["default_value"] = '-'
                    attribuutdict["keuzelijstopties"] = ['-','True','False']
                    attribuutdict["keuzelijstnaam"] = 'booleanlijst'
    
            #KEUZELIJSTOPTIES
            elif OTL_datatype.naam.startswith("Kl"):
                attribuutdict["datatype_attribuut"] = 'keuzelijst'
                attribuutdict["default_value"] = '-'
                keuzelijstopties = ["-"] #Default value voor keuzelijst moet in lijst voorkomen
                for i, k in enumerate(attr.field.options.keys()):
                    keuzelijstopties.append(k)
                attribuutdict["keuzelijstopties"] = keuzelijstopties
                attribuutdict["keuzelijstnaam"] = str(attr.field.naam)       
            else: #Speciale gevallen altijd string nemen
                attribuutdict["datatype_attribuut"] = "Text"
                attribuutdict["default_value"] = ""
        else:#indien geen datatype gevonden
            attribuutdict["datatype_attribuut"] = "Text"
            attribuutdict["default_value"] = ""

    return attribuutdict

def create_psetnaam(obj, urilijst):
    """Maakt de unieke propertysetnaam voor een object"""

    #Naam en soort van de klasse
    objectnaam = obj.__class__.__name__
    objectsoort = obj.typeURI.split('/')[-1].split('#')[0] #objectsoort afleiden uit typeURI

    #Deprecation label toevoegen
    if hasattr(obj, 'deprecated_version'):
        depr = "_DEPR-" + str(obj.deprecated_version)
    else:
        depr = ""

    #Controle of naam reeds voorkomt
    if sum(s.endswith('#' + objectnaam) for s in urilijst) == 1:
        propertysetnaam = "OTL_" + objectnaam + depr
    else: 
        propertysetnaam = "OTL_" + objectnaam + "_" + objectsoort + depr 

    return propertysetnaam


def get_dotnotation(obj):
    """creer de dotnotatie weergave voor de attributen"""
    
    obj.fill_with_dummy_data() #Vul het object met dummy data, zodat deze bruikbaar is voor dotnotationdict

    #Workaround voor ListOfList error bij dotnotatie creatie:
    if obj.typeURI == "https://wegenenverkeer.data.vlaanderen.be/ns/implementatieelement#Toegangsprocedure": 
        obj.bijlage = None

    try:
        d_dict = DotnotationDictConverter.to_dict(obj) #Vertaal alle attributen naar dotnotatie
    except Error as e:
        ctypes.windll.user32.MessageBoxW(0, str(e), "Dotnotatie aanmaken gefaald", 0)
        pass

    return d_dict
    
#MAIN FUNCTION
def OTL_to_dict(OTL_subset, filter_subsetattributen:bool):
    """Gebruikt de OTLMOW model om info uit een OTL subset te vertalen naar een dict bruikbaar voor het opmaken van civil3D propertysets"""

    if exists(OTL_subset):
        eindlijst = [] 

        urilijst = select_klasses(OTL_subset) #haal een lijst van object uris op uit de OTL subset

        for uri in urilijst:

            obj = dynamic_create_instance_from_uri(uri) #Instantieer de klasse via het OTLMOW model
            dotnotatie_attributen = get_dotnotation(obj) #Haalt alle dotnotatie attributen op voor het object 
            subsetattributen = select_attributen(OTL_subset, obj.typeURI) #haal een lijst van de attributen voor het object uit de subset

            #Verzamel info over het onderdeel (of installatie, implemenatieelement, ...)
            onderdeeldict = {} #een dict om alle info voor een bepaalde propertyset in te verzamelen
            onderdeeldict["propertysetnaam"] = create_psetnaam(obj, urilijst) #creert een unieke propertysetnaam
            onderdeeldict["definitie"] = (obj.__doc__[:250] + '..') if len(obj.__doc__) > 250 else obj.__doc__
            onderdeeldict["typeURI"] = obj.typeURI
            onderdeeldict["attributen"] = []
    
            #Verzamel info per attribuut, indien gevraagd volgens subset
            for attribute in dotnotatie_attributen:
                if filter_subsetattributen: #Enkel de attributen uit de subset meenemen
                    if attribute.split(".")[0] in subsetattributen:
                        attribuutdict = attribute_info_to_dict(obj,attribute)
                    else:
                        attribuutdict = {}

                else: attribuutdict = attribute_info_to_dict(obj,attribute) #Alle attributen uit het OTL model meenemen

                if attribuutdict: #Voegt enkel toe aan attributenlijst in dict als er een attribuutdict werd gemaakt.
                    onderdeeldict["attributen"].append(attribuutdict) #Voeg de attribuutinfo toe aan de dict voor dit onderdeel

            eindlijst.append(onderdeeldict)


    else: #Een dummy maken als er geen gebruikersinput gegeven is, zodat dynamo geen 'none' krijgt
        eindlijst = []
        onderdeeldict = dummydict()

    return eindlijst


#UITVOEREN
doelpad = [0]
subsetpad = IN[1]
subset_filter = IN[2]
go = IN[3]

OUT = ""
if go:
    try:
        #NODIGE MODULES UIT OTLMOW CONVERTER INLADEN
        from otlmow_converter.DotnotationDictConverter import DotnotationDictConverter
        from otlmow_converter.DotnotationHelper import DotnotationHelper
        
        #NODIGE MODULES UIT OTLMOW MODEL INLADEN
        from otlmow_model.OtlmowModel.BaseClasses.KeuzelijstField import KeuzelijstField
        from otlmow_model.OtlmowModel.BaseClasses.StringField import StringField
        from otlmow_model.OtlmowModel.BaseClasses.BooleanField import BooleanField
        from otlmow_model.OtlmowModel.BaseClasses.FloatOrDecimalField import FloatOrDecimalField
        from otlmow_model.OtlmowModel.BaseClasses.NonNegIntegerField import NonNegIntegerField
        from otlmow_model.OtlmowModel.BaseClasses.IntegerField import IntegerField
        from otlmow_model.OtlmowModel.BaseClasses.OTLObject import OTLAttribuut
        from otlmow_model.OtlmowModel.BaseClasses.OTLObject import dynamic_create_instance_from_uri


    except Exception as e:
        ctypes.windll.user32.MessageBoxW(0, f"Fout bij inladen van libraries:{e}", "OTL data naar dict", 0)   
        
    try:
        #OMZETTING STARTEN
        OUT = OTL_to_dict(subsetpad,subset_filter)
        
    except Exception as e:
        ctypes.windll.user32.MessageBoxW(0, f"Er liep iets mis in het omzetten van de OTL data naar dynamo:{e}", "OTL data naar dict", 0)        
# ----------------------------------------
psetdef_aanmaken = Python(IN[0]=otldata_to_dict)  # CPython3
# ---------- psetdef_aanmaken.python (178 lines) ----------
# Load the Python Standard and DesignScript Libraries
import clr
import ctypes

# Add Assemblies for AutoCAD and Civil3D
clr.AddReference('AcMgd')
clr.AddReference('AcCoreMgd')
clr.AddReference('AcDbMgd')
clr.AddReference('AecBaseMgd')
clr.AddReference('AecPropDataMgd')
clr.AddReference('AeccDbMgd')

# Import references from AutoCAD
from Autodesk.AutoCAD.Runtime import *
from Autodesk.AutoCAD.ApplicationServices import *
from Autodesk.AutoCAD.EditorInput import *
from Autodesk.AutoCAD.DatabaseServices import *
from Autodesk.AutoCAD.Geometry import *

# Import references from Civil3D
from Autodesk.Civil.ApplicationServices import *
from Autodesk.Civil.DatabaseServices import *

# Import references for PropertySets
from Autodesk.Aec.PropertyData import *
from Autodesk.Aec.PropertyData.DatabaseServices import *

# Import references for ListDefinitions
from Autodesk.Aec.DatabaseServices import ListDefinition, ListItem, DictionaryListDefinition

adoc = Application.DocumentManager.MdiActiveDocument
editor = adoc.Editor

def listdef_uit_keuzelijstoptie(lijstnaam,lijstopties):
    with adoc.LockDocument():
        with adoc.Database as db:
            ld = None
            ldid = None
            newld = False            
            with db.TransactionManager.StartTransaction() as t:
                dld = DictionaryListDefinition(db)
                try:
                    lname = lijstnaam
                    
                    if not dld.Has(lname, t):
                        ld = ListDefinition()
                        ld.AppliesToAll = True
                        ld.AlternateName = lname
                        ld.AllowToVary = False
                        ld.Description = lname

                        dld.AddNewRecord(lname, ld)
                        newld = True
                    else:
                        ldid = dld.GetAt(lname)
                        ld = t.GetObject(ldid, OpenMode.ForWrite)
                    if newld:
                        t.AddNewlyCreatedDBObject(ld, True)

                    for optie in lijstopties:
                        first = True
                        for oid in ld.GetListItems():
                            li = t.GetObject(oid, OpenMode.ForRead)
                            if li.Name == optie:
                                first = False
                                break
                        if first:
                            ld.AddListItem(optie)
                    message = ld
                    t.Commit()
                except:
                    message = "er ging iets mis met het aanmaken van lijst" + lijstnaam
    return ld.Name
    
def dict_to_psetdef(OTL_psetinfoDict):
    """OTL Data uit een dict wegschrijven naar de propertyset definitions"""
    with adoc.LockDocument():
        with adoc.Database as db:
            with db.TransactionManager.StartTransaction() as t:
                dpsd = DictionaryPropertySetDefinitions(db)
                outputlijst = []
                psetdef_count = -1
                pdn_count = -1
                for onderdeeldict in OTL_psetinfoDict:
                    od = onderdeeldict                    
                    
                    try:
                        if od["propertysetnaam"] == "OTL_dummy":
                            pass                      
                        else:
                            if not dpsd.Has(od["propertysetnaam"], t): #propertysetnaam bestaat nog niet, maak een nieuwe
                                psdef = PropertySetDefinition()
                                psdefid = psdef.Id
                                dpsd.AddNewRecord(od["propertysetnaam"], psdef)
                                newps = True #?
                                t.AddNewlyCreatedDBObject(psdef, True)
                                    
                            else: #de propertysetnaam bestaat al in de definitions, open deze
                                psdefid = dpsd.GetAt(od["propertysetnaam"])
                                psdef = t.GetObject(psdefid, OpenMode.ForWrite)
                                
                            psdef.SetToStandard(db)
                            psdef.SubSetDatabaseDefaults(db)
                            psdef.AppliesToAll = True
                            psdef.Description = od["definitie"]
                            
                            outputlijst.append(psdef.Name)
                            
                            definitions = psdef.Definitions
                            
                            psetdef_count = psetdef_count + 1                        
                                                    
                            for attribuutdict in od["attributen"]:
                                ad = attribuutdict
                                pdn_count = pdn_count + 1
                                
                                if ad["dotnotatie_attribuutnaam"]:
                                    try:
                                        if ad["datatype_attribuut"] == "keuzelijst": #voor de keuzelijst attributen
                                            listdef_uit_keuzelijstoptie(ad["keuzelijstnaam"],ad["keuzelijstopties"])
                                            
                                            pd = PropertyDefinition()
                                            pd.Name = ad["dotnotatie_attribuutnaam"]
                                            pd.Description = ad["attribuutdefinitie"]
                                            pd.DataType = DataType.Parse(DataType, "List", True)
                                            
                                            dld = DictionaryListDefinition(db)
                                            ldid = dld.GetAt(ad["keuzelijstnaam"])
                                            pd.ListDefinitionId = ldid
                                            
                                            ldef = t.GetObject(ldid, OpenMode.ForRead)
                                            default = t.GetObject(ldef.GetListItems()[0], OpenMode.ForRead)
                                            pd.DefaultData = default.Name
                                            
                                        
                                        else: #voor alle niet keuzelijst attributen                            
                                            pd = PropertyDefinition()
                                            pd.Name = ad["dotnotatie_attribuutnaam"]
                                            pd.Description = ad["attribuutdefinitie"]
                                            pd.DataType = DataType.Parse(DataType, ad["datatype_attribuut"], True)
                                            #pd.DefaultData = ad["default_value"]
                                            
                                            if pd.DataType == DataType.Real:
                                                pd.DefaultData = -999999999.000000
                                            if pd.DataType == DataType.Integer:
                                                pd.DefaultData = -999999999
                                            elif ad["dotnotatie_attribuutnaam"] == "typeURI":
                                                pd.DefaultData = od["typeURI"]
                                            
                                        if not definitions.Contains(pd): #dubbele keys vermijden
                                            definitions.Add(pd)
                                        
                                    except:
                                        outputlijst = ["attribuut: er ging iets mis ", ad["dotnotatie_attribuutnaam"], od["propertysetnaam"],ad["attribuutdefinitie"],ad["datatype_attribuut"],ad["default_value"]]                    
                        
                    except:
                        outputlijst = ["onderdeel: er ging iets mis bij het aanmaken van volgend item: ", od["propertysetnaam"]]
                        
                t.Commit()

    info = str(pdn_count+1) + " Properties aangemaakt in " + str(psetdef_count+1) + " Propertysets"
    
    nl = "\n"
    if len(outputlijst) < 30:
        message = f"{info}{nl}Volgende sets werden aangemaakt:{nl}{nl.join(outputlijst)}"
    else:
        message = f"{info}{nl}Onder meer volgende sets werden aangemaakt:{nl}{nl.join(outputlijst[:30])}{nl}..."
        outputlijst = outputlijst[:30]
    ctypes.windll.user32.MessageBoxW(0, message, "Propertysets aangemaakt", 0)
    return [info,outputlijst]


#UITVOEREN
OUT = "GEEN propertysets aangemaakt"
OTL_datadict = IN[0]
if OTL_datadict:
    OUT = dict_to_psetdef(OTL_datadict)
    
# ----------------------------------------

# group: Output message
Propertyset_Info = Output(psetdef_aanmaken)  # Aangemaakte propertysets
