# Dynamo custom node OTL_Export_psetdata_to_csv.dyf (Dynamo 3.6.1.9956)
# category: Civil3D_OTL_MOW_Toolkit
# OTL-data uit de .dwg exporteren naar CSV, om deze data in te zetten in andere processen. Bijvoorbeeld om te gebruiken in de OTL wizard 2, met OTL_Export_psetdata_to_csv

doel_folder_of_csv_filepad = Input(doel_folder_of_csv_filepad: string = "")  # Het pad naar een folder om een CSV of meerdere CSV files in weg te schrijven
Aparte_Files = Input(Aparte_Files: bool = false)  # Bij 'True' word voor elk OTL type een aparte CSV file aangemaakt (enkel indien folderpad)

# group: OTL_Export_psetdata_to_csv
check_input_folder = Python(IN[0]=doel_folder_of_csv_filepad)  # CPython3
# ---------- check_input_folder.python (30 lines) ----------
# Load the Python Standard and DesignScript Libraries
import os
import ctypes


#INPUT
input_file_of_folder = IN[0]

go = 0
message = ""
m = ctypes.windll.user32
nl = '\n'


if input_file_of_folder:
    if os.path.isdir(input_file_of_folder):#bij folder
        message = f"Correcte input, CSV bestanden worden geschreven in de folder: {nl}{str(input_file_of_folder)}"
        go = 1
                
    elif os.path.isfile(input_file_of_folder):#bij file
        message = f"Opgegeven pad is het pad naar een file: {nl}{str(input_file_of_folder)}{nl}{nl}Geef een folder waar de file mag worden geschreven,{nl}gebruik daarvoor de 'Directory Path' node"
        
    else:
        message = f"Geen bruikbare input:{nl}{str(input_file_of_folder)}{nl}{nl}Geef een locatie op om de csv files naar te schrijven,{nl}gebruik daarvoor de 'Directory Path' node"

else:
    message = f"Geen bruikbare input:{nl}{str(input_file_of_folder)}{nl}{nl}Geef een locatie op om de csv files naar te schrijven,{nl}gebruik daarvoor de 'Directory Path' node"

m.MessageBoxW(0, message, "OTL_Export psetdata to CSV", 0)
OUT = go
# ----------------------------------------
alle_layers_ophalen = Python(IN[0]=check_input_folder)  # CPython3
# ---------- alle_layers_ophalen.python (37 lines) ----------
import clr

# Voeg de benodigde AutoCAD references toe
clr.AddReference('AcMgd')
clr.AddReference('AcCoreMgd')
clr.AddReference('AcDbMgd')

from Autodesk.AutoCAD.ApplicationServices import Application
from Autodesk.AutoCAD.DatabaseServices import OpenMode

# Haal het actieve document en de database op
adoc = Application.DocumentManager.MdiActiveDocument
db = adoc.Database

go = IN[0]
layer_names = []

if go:
    # Zorg ervoor dat het document gelocked is voordat je de database uitleest
    with adoc.LockDocument():
        # Start een transactie
        with db.TransactionManager.StartTransaction() as t:
            # Open de Layer Table met leesrechten
            layer_table = t.GetObject(db.LayerTableId, OpenMode.ForRead)
            
            # Loop door alle lagen in de tabel
            for layer_id in layer_table:
                layer = t.GetObject(layer_id, OpenMode.ForRead)
                layer_names.append(layer.Name)
                
            t.Commit()
    
    # Stuur de lijst met laagnamen naar de output van de node
    OUT = layer_names
    
else:
    OUT = 0
# ----------------------------------------
current_doc_ophalen = Python(IN[0]=alle_layers_ophalen)  # CPython3
# ---------- current_doc_ophalen.python (16 lines) ----------
import clr

# Laad de Dynamo AutoCAD API in
clr.AddReference('AutoCADNodes')
from Autodesk.AutoCAD.DynamoNodes import Document

layerlijst= IN[0]

if layerlijst:
    # Haal direct het actieve Dynamo-document op
    dyn_doc = Document.Current
    # Stuur het Dynamo-document naar de output
    OUT = layerlijst, dyn_doc
    
else:
    OUT = ["",""]
# ----------------------------------------
code_block = CodeBlock(out=current_doc_ophalen) { layerlijst = out[0]; currentdoc= out[1]; }
modelSpace = Autodesk.AutoCAD.DynamoNodes.Document.ModelSpace(document=code_block.currentdoc)
all_objects_on_layer = AcObjectsOnLayer(layerName=code_block.layerlijst, block=modelSpace)
flatten = List.Flatten(list=all_objects_on_layer)
propertySets = Autodesk.AutoCAD.DynamoNodes.Object.PropertySets(object=flatten)
name = Autodesk.AutoCAD.DynamoNodes.PropertySet.Name(propertySet=propertySets)
code_block_2 = CodeBlock { "OTL_"; }
startsWith = String.StartsWith(string=name, searchFor=code_block_2)
filterByBoolMask = List.FilterByBoolMask(list=propertySets, mask=startsWith)
flatten_2 = List.Flatten(list=filterByBoolMask.in)
properties = Autodesk.AutoCAD.DynamoNodes.PropertySet.Properties(propertySet=flatten_2)
name_2 = Autodesk.AutoCAD.DynamoNodes.Property.Name(property=properties)
value = Autodesk.AutoCAD.DynamoNodes.Property.Value(property=properties)
byKeysValues = DesignScript.Builtin.Dictionary.ByKeysValues(keys=name_2@L2, values=value@L2)
python_script = Python(IN[0]=byKeysValues, IN[1]=doel_folder_of_csv_filepad, IN[2]=Aparte_Files)  # CPython3
# ---------- python_script.python (111 lines) ----------
import collections
import csv
import ctypes
from os import path
m = ctypes.windll.user32

#inputs
pset_dicts = IN[0]
inputpath = IN[1]
aparte_file = IN[2]

#variabelen
nl = "\n"
messagelist = []

def csv_schrijven(data,filepath):
    """CSV wegschrijven"""
    try:
        with open(filepath, 'w', newline='', encoding='utf-8') as f:
            writer = csv.writer(f, delimiter=';')
            writer.writerows(data)
        filename = filepath.split("\\")[-1]
        message = f"{(len(data)-1)} rijen geschreven in {filename}"    
    except Exception as e:
        message = f"Er is een fout opgetreden bij het schrijven naar het bestand: {e}"
    return message

def create_otl_datalist(dictlijst,headerkeys):
    """lijst deconstrueren & defaults overschrijven"""
    totalvaluelist = [headerkeys]
    for d in dictlijst:
        itemvaluelist = [] 
        for header in headerkeys:
            if header in d:
                if d[header] == -999999999 or d[header] == "-":
                    itemvaluelist.append("")
                else:
                    itemvaluelist.append(d[header])
            else:
                itemvaluelist.append("")
        totalvaluelist.append(itemvaluelist)
    return totalvaluelist 
    

def file_per_OTL_type(pset_dicts,folderpath):
    """maakt een aparte lijst van pset_dicts per typeURI waarde, en schrijf voor elk een file als csv"""
    result = collections.defaultdict(list)
    for d in pset_dicts:
        if 'typeURI' in d.keys():
            result[d['typeURI']].append(d)
        else:
            pass
    result_list = list(result.values())
    
    objectnamen = [] #om te checken op dubbele namen
    filepaths = []
    
    for l in result_list:
        """filepaden aanmaken"""
        laatste_deel_uri = l[0]['typeURI'].split('/')[-1]
        objectnaam = str(laatste_deel_uri.partition('#')[-1])
        objectsoort = str(objectnaam.partition('#')[0].title())
        if objectnaam in objectnamen:
            objectnaam = objectnaam + "_" + objectsoort
        objectnamen.append(objectnaam)
            
        filepath = folderpath + "\\" + objectnaam + ".csv"
        filepaths.append(filepath)
        
        dl = create_otl_datalist(l,list(l[0].keys()))
        c = csv_schrijven(dl,filepath)
        messagelist.append(c)
        
    m.MessageBoxW(0, f"{nl.join(messagelist)}", "OTL_Export psetdata to CSV", 0)
    return messagelist

def alles_in_een_OTL_file(pset_dicts,filepath):
    """zet alles in 1 lijst en schrijft naar een file in csv"""
    headerkeys = ["assetId.identificator","typeURI"]
    for d in pset_dicts:
        for k in d.keys():
            if k not in headerkeys:
                headerkeys.append(k)
    dl = create_otl_datalist(pset_dicts,headerkeys)
    c = csv_schrijven(dl,filepath)
    messagelist.append(c)
    m.MessageBoxW(0, f"{nl.join(messagelist)}", "OTL_Export psetdata to CSV", 0)
    return messagelist

    
#MAIN
if pset_dicts[0]:#Check of er psets zijn
    if path.isfile(inputpath):
        result = alles_in_een_OTL_file(pset_dicts,inputpath)
    elif path.isdir(inputpath):
        if aparte_file:
            result = file_per_OTL_type(pset_dicts,inputpath)
        else:
            filenaam = "OTL_Export_psetdata"
            filepath = inputpath + "\\" + filenaam + ".csv"
            result = alles_in_een_OTL_file(pset_dicts,filepath)
    else:
        message = f"Geen geldige folder of file om csv naar te schrijven"
        result = message
        m.MessageBoxW(0, message, "OTL_Export psetdata to CSV", 0)
else:
    message = f"Geen propertysetinfo naar CSV geschreven"
    result = message
    m.MessageBoxW(0, message, "OTL_Export psetdata to CSV", 0)
    
OUT = result
# ----------------------------------------

Result = Output(python_script)  # Aantal weggeschreven rijen naar CSV
