# Dynamo custom node OTL_Pset_by_layermapping.dyf (Dynamo 3.4.1.7055)
# category: Civil3D_OTL_MOW_Toolkit
# Een OTL-propertyset aan objecten koppelen a.d.h.v. hun AutoCAD-layer

# group: Layermapping CSV inlezen
mappingfile_locatie = Input(mappingfile_locatie: string = "")  # Een CSV (komma-delimiter) met twee kolommen: Layernaam,Propertysetdefinition naam
file_path = Filename(".\layermapping.csv")
boolean = BoolSelector(false)
importCSV = Data.ImportCSV(filePath=file_path, transpose=boolean)

# group: Lijstitems selecteren
firstItem = List.FirstItem(list=importCSV)
lastItem = List.LastItem(list=importCSV)

# group: Objecten opvragen in deze layers
current = Autodesk.AutoCAD.DynamoNodes.Document.Current()
modelSpace = Autodesk.AutoCAD.DynamoNodes.Document.ModelSpace(document=current)
all_objects_on_layer = AcObjectsOnLayer(layerName=firstItem, block=modelSpace)

# group: Property set koppelen aan objecten
addPropertySet = Autodesk.AutoCAD.DynamoNodes.Object.AddPropertySet(object=all_objects_on_layer, propertySetDefinitionName=lastItem)

Gewijzigde_objecten = Output(addPropertySet)  # Objecten met toegevoegde propertyset
