# Dynamo graph OTL_Create_propertset_definitions_gebruiksvoorbeeld.dyn (Dynamo 3.4.1.7055)

# group: Library_download
boolean = BoolSelector(false)

# group: Doelpad
directory_path = Directory("C:\Users\ruben\Desktop\test_45")

# group: Subset db
file_path = Filename("..\subsets\leeg.db")

# group: Subset filter
boolean_2 = BoolSelector(true)

OTL_Create_propertset_definitions = Custom[OTL_Create_propertset_definitions](Library_Downlaod=boolean, OTL_libraries_folder=directory_path, OTL_SUBSET=file_path, Attribuut_filter=boolean_2)  # Methode om vanuit een OTL subset property set definitions aan te maken in een dwg. Download en gebruikt hiervoor de Python OTLMOW libraries. Bruikbaar in dynamo 3.0 (vanaf civil3D 2025)
