# Dynamo graph OTL_Export_psetdata_to_csv_gebruiksvoorbeeld.dyn (Dynamo 3.4.1.7055)

directory_path = Directory("C:\Users\ruben\Desktop\csv-out-test")
boolean = BoolSelector(true)
OTL_Export_psetdata_to_csv = Custom[OTL_Export_psetdata_to_csv](doel_folder_of_csv_filepad=directory_path, Aparte_Files=boolean)  # OTL-data uit de .dwg exporteren naar CSV, om deze data in te zetten in andere processen. Bijvoorbeeld om te gebruiken in de OTL wizard 2, met OTL_Export_psetdata_to_csv
