# Dynamo graph OTL_Set_attribute_value_gebruiksvoorbeeld.dyn (Dynamo 3.4.1.7055)

code_block = CodeBlock { "assetId.identificator"; "assetId.toegekendDoor"; }
code_block_2 = CodeBlock { ""; }
code_block_3 = CodeBlock { "random"; "RDW"; }
OTL_Set_attribute_value = Custom[OTL_Set_attribute_value](attribuutnaam=code_block.out1, te_vervangen_waarde=code_block_2, in_te_vullen_waarde=code_block_3.out1)  # Het in bulk aanpassen van OTL attribuutwaarden
