# Dynamo graph OTL_Bulk_update_property_value.dyn (Dynamo 2.13.1.3887)

code_block = CodeBlock { "random"; }

# group: Selecteer alle objecten
current = Autodesk.AutoCAD.DynamoNodes.Document.Current()
python_script_layernames = Python(IN[0]=current)  # CPython3
# ---------- python_script_layernames.python (47 lines) ----------
# Load the Python Standard and DesignScript Libraries
import sys
import clr

# Add Assemblies for AutoCAD and Civil3D
clr.AddReference('AcMgd')
clr.AddReference('AcCoreMgd')
clr.AddReference('AcDbMgd')
clr.AddReference('AecBaseMgd')
clr.AddReference('AecPropDataMgd')
clr.AddReference('AeccDbMgd')

# Import references from AutoCAD
from Autodesk.AutoCAD.Runtime import *
from Autodesk.AutoCAD.ApplicationServices import *
from Autodesk.AutoCAD.EditorInput import *
from Autodesk.AutoCAD.DatabaseServices import *
from Autodesk.AutoCAD.Geometry import *

# Import references from Civil3D
from Autodesk.Civil.ApplicationServices import *
from Autodesk.Civil.DatabaseServices import *

# The inputs to this node will be stored as a list in the IN variables.
dataEnteringNode = IN

adoc = Application.DocumentManager.MdiActiveDocument
editor = adoc.Editor

layernames = []

# LAYERS AANMAKEN
# Via python voor gebruik in verschillende dynamo versies,
# waar verschil is in document.layers of document.layernames

with adoc.LockDocument():
    with adoc.Database as db:
        with db.TransactionManager.StartTransaction() as t:
            layertable = t.GetObject(db.LayerTableId,OpenMode.ForRead)
            for layerId in layertable:
                layerobj = t.GetObject(layerId, OpenMode.ForRead)
                layernames.append(layerobj.Name)
                
            t.Commit()

# Assign your output to the OUT variable.
OUT = layernames
# ----------------------------------------
modelSpace = Autodesk.AutoCAD.DynamoNodes.Document.ModelSpace(document=current)
all_objects_on_layer = AcObjectsOnLayer(layer=python_script_layernames, block=modelSpace)
flatten = List.Flatten(list=all_objects_on_layer)

# group: enkel OTL psets uitfilteren
propertySets = Autodesk.AutoCAD.DynamoNodes.Object.PropertySets(object=flatten)
name = Autodesk.AutoCAD.DynamoNodes.PropertySet.Name(propertySet=propertySets)
code_block_2 = CodeBlock { "OTL_"; }
startsWith = String.StartsWith(string=name, searchFor=code_block_2)
filterByBoolMask = List.FilterByBoolMask(list=propertySets, mask=startsWith)

boolean = BoolSelector(true)
contains = List.Contains(list=startsWith@L2, item=boolean)

# group: prop. sets
filterByBoolMask_2 = List.FilterByBoolMask(list=filterByBoolMask.in, mask=contains)

watch = Watch(filterByBoolMask_2.in)

# group: Objecten
filterByBoolMask_3 = List.FilterByBoolMask(list=flatten, mask=contains)

code_block_3 = CodeBlock { "bestemming"; }
code_block_4 = CodeBlock(i=code_block_3) { i; }
code_block_5 = CodeBlock { ""; }
code_block_6 = CodeBlock { "hergebruik"; }
code_block_7 = CodeBlock(r=code_block_6) { r; }

# group: IDs invullen
code_block_8 = CodeBlock(propertynaam=code_block_4) { propertynaam; }
propertyByName = Autodesk.AutoCAD.DynamoNodes.PropertySet.PropertyByName(propertySet=filterByBoolMask_2.in, name=code_block_8)
value = Autodesk.AutoCAD.DynamoNodes.Property.Value(property=propertyByName)
code_block_9 = CodeBlock(teZoekenWaarde=code_block_5) { teZoekenWaarde; }
eq = value == code_block_9
boolean_2 = BoolSelector(true)
contains_2 = List.Contains(list=eq@L2, item=boolean_2)
filterByBoolMask_4 = List.FilterByBoolMask(list=filterByBoolMask_3.in, mask=contains_2)
name_2 = Autodesk.AutoCAD.DynamoNodes.PropertySet.Name(propertySet=filterByBoolMask_2.in)
filterByBoolMask_5 = List.FilterByBoolMask(list=name_2, mask=eq)
filterByBoolMask_6 = List.FilterByBoolMask(list=filterByBoolMask_5.in, mask=contains_2)
name_3 = Autodesk.AutoCAD.DynamoNodes.Property.Name(property=propertyByName)
filterByBoolMask_7 = List.FilterByBoolMask(list=name_3, mask=eq)
filterByBoolMask_8 = List.FilterByBoolMask(list=filterByBoolMask_7.in, mask=contains_2)
python_script_id_generator = Python(IN[0]=name_2, IN[1]=code_block_7, IN[2]=name_3, IN[3]=value, IN[4]=code_block_9)  # CPython3
# ---------- python_script_id_generator.python (64 lines) ----------
# Load the Python Standard uuid Library
import uuid
import ctypes

lijst_ids = []
all_OTL_propsetnames = IN[0]#Hoeveel IDs aan te maken
inputwaarde = IN[1]
propertynamelist = IN[2]
propertyvaluelist = IN[3]
tezoekenvalue = IN[4]
nl = "\n"

check = []#controleren of er zeker geen dubbels worden aangemaakt
aantalwaarden = 0
propertyname = ""#Een dummy voor wanneer niks gevonden

if propertynamelist:
    psetnames = []
    i = -1
    for n in propertynamelist:
        i = i + 1
        if n[0] != "null":#de property bestaat in de pset
            if propertyvaluelist[i][0] == tezoekenvalue:
                    aantalwaarden = aantalwaarden + 1
                    propertyname = n[0]#pas toekennen wanneer gevonden
                    psetname = all_OTL_propsetnames[i][0]
                    #ctypes.windll.user32.MessageBoxW(0, f"index:{i}{nl}properyname:{n[0]}{nl}psetname:{psetname}", "OTL_Bulk_update", 0)
                    if psetname not in psetnames:
                        psetnames.append(psetname)
    
    for l in all_OTL_propsetnames:
        sublist = []
        for i in l:
            if inputwaarde == "random":
                id = "gen_"+str(uuid.uuid4()).split("-")[0]
                if id not in check:
                     sublist.append(id)
                     check.append(id)
                else:
                    id = id[-1]+"a"
                    sublist.append(id)
                    check.append(id)
                lijst_ids.append(sublist)
            else:#bij niet random waarde
                sublist.append(inputwaarde)
                lijst_ids.append(sublist)
                check.append(inputwaarde)
                
        
    
    if check:
        if inputwaarde == "random":
            message = f"Er werden {aantalwaarden} waardes gegenereerd om in te vullen bij '{propertyname}' in de plaats van '{tezoekenvalue}' in de volgende propertysets: {nl}{nl}{nl.join(psetnames)}"
        else:
            message = f"De waarde: '{inputwaarde}' werd {aantalwaarden} keer herhaald om in te vullen in de plaats van '{tezoekenvalue} bij '{propertyname}' in de volgende propertysets: {nl}{nl}{nl.join(psetnames)}"
    else:
        message = "GEEN objecten gevonden om attributen voor te wijzigen"

else:
    message = "GEEN objecten gevonden om attributen voor te wijzigen"

ctypes.windll.user32.MessageBoxW(0, message, "OTL_Bulk_update", 0)

OUT = lijst_ids
# ----------------------------------------
filterByBoolMask_9 = List.FilterByBoolMask(list=python_script_id_generator, mask=eq)
filterByBoolMask_10 = List.FilterByBoolMask(list=filterByBoolMask_9.in, mask=contains_2)
updateProperty = Autodesk.AutoCAD.DynamoNodes.Object.UpdateProperty(object=filterByBoolMask_4.in, propertySetName=filterByBoolMask_6.in, propertyName=filterByBoolMask_8.in, propertyValue=filterByBoolMask_10.in)

flatten_2 = List.Flatten(list=updateProperty)
code_block_10 = CodeBlock(Objecten_met_gewijzigde_attributen=flatten_2)
# ---------- code_block_10.designscript (2 lines) ----------
// Objecten waarvoor ID toegevoegd werd
Objecten_met_gewijzigde_attributen;
# ----------------------------------------
watch_2 = Watch(filterByBoolMask_3.in)
code_block_11 = CodeBlock()
# ---------- code_block_11.designscript (2 lines) ----------
/*De attribuut die vervangen mag worden */
attribuutnaam: string = "assetId.identificator";
# ----------------------------------------
code_block_12 = CodeBlock { "assetId.identificator"; }
code_block_13 = CodeBlock()
# ---------- code_block_13.designscript (2 lines) ----------
/*De waarde die vervangen mag worden */
lege_id: string = "";
# ----------------------------------------
code_block_14 = CodeBlock()
# ---------- code_block_14.designscript (2 lines) ----------
/*De waarde die ingevuld mag worden. Bij leeg laten zel een willekeurige waarde genereerd worden */
lege_id: string = "random";
# ----------------------------------------
code_block_15 = CodeBlock { "Ruben"; }
code_block_16 = CodeBlock { "assetId.toegekendDoor"; }
python_script = Python(IN[0]=updateProperty)  # CPython3
# ---------- python_script.python (18 lines) ----------
# Load the Python Standard Library
import ctypes

aantal_objecten = IN[0]

nl = "\n"

check = []#controleren of er zeker geen dubbels worden aangemaakt

if aantal_objecten:
    message = f"Updaten van attributen geslaagd voor:{nl}{len(aantal_objecten)} objecten"

else:
    message = f"FOUT: GEEN attributen gewijzigd"

ctypes.windll.user32.MessageBoxW(0, message, "OTL_Bulk_update", 0)

OUT = message
# ----------------------------------------
code_block_17 = CodeBlock { nog iets voorzien voor wanneer een ongeldige KL waarde werd opgegeven; }  # frozen
