# Dynamo graph OTL_Propertysets_aanmaken_25.dyn (Dynamo 2.15.1.6076)

# group: toolkit_update
# Download en update de nodige Python modules
boolean = BoolSelector(true)

# group: Doelpad
# Pad waar de OTL toolkit python modules bewaard worden
directory_path = Directory("C:\Users\ruben\Desktop\testBB")

# group: Haalt package path op
python_script = Python(IN[0]=directory_path)  # CPython3
# ---------- python_script.python (54 lines) ----------
#Deze codeblock zit ingewerkt in het script
import os.path
from System.Reflection import Assembly
import xml.etree.ElementTree as et
import ctypes

user_input_path = IN[0]

if user_input_path:
    if isinstance(user_input_path, str):
        if os.path.isdir(user_input_path):
            OUT = ["geldig",user_input_path]
        else:
            user_input_path = "ongeldig"
    else:
        user_input_path = "ongeldig"
        
else:
    #Er werd geen user waarde opgegeven
    #ZOEKT DE FOLDER ZOEKEN WAAR PACKAGE IS OPGESLAGEN
    folderstring_na_version = r'\packages\OTL_MOW_Toolkit\extra' #einde van het pad
    
    try:    
        appDataPath = os.getenv('APPDATA') #de appdata locatie
        #de dynamo & civil versie ophalen
        dynamo = Assembly.Load('DynamoCore')   
        civil_version = str(dynamo.CodeBase).split("AutoCAD", 1)[1][1:5] #Civil versie opzoeken adhv locatie van dyn assembly
        dynamo_version = ".".join(str(dynamo.GetName().Version).split(".", 2)[:2]) #dynamo versie ophalen
        ctypes.windll.user32.MessageBoxW(0, str(civil_version), "Gevonden civilversie", 0)
        
        found_dynpath = appDataPath + r'\Autodesk\C3D ' + civil_version + r'\Dynamo' + '\\' + dynamo_version
        
        if os.path.isdir(found_dynpath):
            #Open de dynamo settings XML en bekijk de folders waar packages zijn opgeslagen:
            doelpath = found_dynpath + r'\packages' #voor wanneer OTL_MOW_Toolkit package folder niet bestaat
            root = et.parse(found_dynpath + "\DynamoSettings.xml").getroot()
            for child in root:
                if child.tag == "CustomPackageFolders":
                    for path in child:
                        path_packages = path.text + folderstring_na_version
                        if os.path.isdir(path_packages):
                            doelpath = path_packages
    
            OUT = OUT = ["geldig",doelpath] #juiste folder naar output
        
        else:
            user_input_path = "ongeldig"
    
    except:
        user_input_path = "ongeldig"
        
if user_input_path == "ongeldig":
    ctypes.windll.user32.MessageBoxW(0, "Geen geldige folder gevonden om libraries op te slaan", "Fout", 0)
    OUT = ["FOUT","Geen geldige folder gevonden om libraries op te slaan"]
# ----------------------------------------

# group: OTL modules en libraries inladen
python_script_2 = Python(IN[0]=boolean, IN[1]=python_script)  # CPython3
# ---------- python_script_2.python (98 lines) ----------
import urllib.request
import sys
from zipfile import ZipFile
import os.path
import ctypes


#DE JUISTE FOLDERS OPHALEN VIA INPUT

downloadcheck = IN[0]
doelpath = IN[1][1]
doelpathceck = IN[1][0]

#FUNCTIE VOOR AFLADEN MODULES
def moduleDownloadenViaZiplink(naam,link,doelpath):
    """Gebruikt een Github link om python modules af te laden en bruikbaar te maken"""
    ziplocatie = f'{doelpath}\\{naam}.zip'

    try:
        urllib.request.urlretrieve(link,ziplocatie)
        #downloadmsg = f'De package {naam} werd gedownload naar locatie {ziplocatie}'
        #ctypes.windll.user32.MessageBoxW(0, downloadmsg , "Donwload library", 0)
        with ZipFile(ziplocatie, 'r') as zObject: 
            zObject.extractall(path=doelpath)
            message = f'Download van {naam} geslaagd'
        if not os.path.isdir(doelpath): #kijken of de folder bestaat
            message = f'FOUT in downloaden of unzippen van {naam} python library'
    except:
        message = f'FOUT in downloaden of unzippen van {naam} python library'

    return message
                  
#FUNCTIE VOOR MODULE TOEVOEGEN AAN PATH
def moduleToevoegenAanPath(modulefolder,naam):
    if os.path.isdir(modulefolder): #kijken of de folder bestaat
        try:
            if modulefolder not in sys.path:
                sys.path.insert(0, modulefolder)
            message = f'Toevoegen van {naam} aan PATH geslaagd'

        except:
            message = f'FOUT in toevoegen van {naam} python library'
   
    else:
        message = f'FOUT in toevoegen van python libraries, folder {modulefolder} bestaat niet, mogelijk zijn ze nog niet gedownload'
    
    return message


def getOTLmodules(doelpath,downloadcheck):
    """referentie welke modules waar opgehaald moeten worden. Toevoeging aan het python Path en testing"""

    if not os.path.isdir(doelpath): #kijken of de folder bestaat
        outputmessage = ["FOUT", f'Het doelpath kon niet worden gevonden {doelpath}']

    else:
        if downloadcheck: #voor het geval de libs gedownload moeten worden
            message = ""
            #OTL dynamo for civil toolkit
            naam = "otlmow_toolkit"
            githublink = r'https://raw.githubusercontent.com/rudewi/Civil3D_OTL_MOW_Toolkit/refs/heads/main/Civil3D_OTL_MOW_Toolkit.zip'
            message = message + "\n" + moduleDownloadenViaZiplink(str(naam),githublink,doelpath)

            #OTLMOW MODEL
            naam = "otlmow_model"
            githublink = r'https://raw.githubusercontent.com/davidvlaminck/OTLMOW-Model/refs/heads/master/source.zip'
            message = message + "\n" + moduleDownloadenViaZiplink(str(naam),githublink,doelpath)
            
            #OTLMOW CONVERTER
            naam = "otlmow_converter"
            githublink = r'https://raw.githubusercontent.com/davidvlaminck/OTLMOW-Converter/refs/heads/master/source.zip'
            message = message + "\n" + moduleDownloadenViaZiplink(str(naam),githublink,doelpath)


        #PAD TOEVOEGEN
        message = message + "\n" + moduleToevoegenAanPath(doelpath,"OTL modules en libraries")


        try:
            from otlmow_model.OtlmowModel.Classes.ImplementatieElement import AIMObject
            from otlmow_converter.DotnotationDictConverter import DotnotationDictConverter
            from OTL_Propertysets_aanmaken.OTL_data_naar_dict import OTL_to_dict

            outputmessage = ["geldig", "OTL modules en libraries zijn succesvol ingeladen: " + "\n" + message + "\n" + f'locatie: {doelpath}' ]

        except:
            outputmessage = ["FOUT", "FOUT bij inladen OTL OTL modules en libraries: " + "\n" + message + "\n" + f'locatie: {doelpath}']


    ctypes.windll.user32.MessageBoxW(0, outputmessage[1], "Inladen libraries", 0)

    return outputmessage

#Uitvoeren
if doelpathceck == "geldig":
    OUT = getOTLmodules(doelpath,downloadcheck)
else:
    OUT = "ongeldig doelpad"
# ----------------------------------------

# group: Subset db
file_path = Filename("..\..\..\..\Downloads\test.db")

# group: SQLITE DB- checken of geldig
string_from_object = FromObject(object=file_path)
python_script_check_op_selectie = Python(IN[0]=string_from_object)  # "Python Script - check op selectie .db file"; CPython3
# ---------- python_script_check_op_selectie.python (58 lines) ----------
from os.path import exists
import sqlite3
import ctypes


gebruikersinput = IN[0]
reden = "geldig"

if isinstance(gebruikersinput, str):
    if exists(gebruikersinput) and gebruikersinput:
        geldig_path = gebruikersinput
        extensie = gebruikersinput.split(".")[-1]
        if extensie != "db":
            geldig_path = "ongeldig"
            reden = "bestand is geen .db bestand"
    else:
        geldig_path = "ongeldig"
        reden = "geen geldige subset gevonden"
else:
    geldig_path = "ongeldig"
    reden = "geen input gevonden"

if reden == "geldig":
    def create_connection(db_file):
        """ maak connectie naar de SQLite database"""
        conn = None
        try:
            conn = sqlite3.connect(db_file)
        except Error as e:
            print(e)
    
        return conn

    def select_klasses(conn):
        """klasses uit sqlite ophalen"""
        conn = create_connection(conn)
        klasses_in_subset = []
        with conn:
            cur = conn.cursor()
            cur.execute("SELECT name FROM sqlite_master WHERE type='table' AND name='OSLOClass';")
            bestaat_klassetabel = cur.fetchall()
            if bestaat_klassetabel:
                cur.execute("SELECT uri FROM OSLOClass WHERE abstract = '0';")
                klasses_in_subset = cur.fetchall()
                klasses_in_subset = klasses_in_subset[0]
        return klasses_in_subset

    sqlite_subset = gebruikersinput
    onderdelen = select_klasses(sqlite_subset)
    if len(onderdelen) == 0:
        reden = "Geen OTL klassen gevonden in db file"
        geldig_path = "ongeldig"

# Assign your output to the OUT variable.
OUT = [reden,geldig_path]

if reden != "geldig":
    ctypes.windll.user32.MessageBoxW(0, reden, "Kon SQlite niet openen", 1)
# ----------------------------------------

# group: Subset filter
# Filtert de attributen per propertyset obv de subset attributen
boolean_2 = BoolSelector(true)

# group: OTL data to dict
python_script_3 = Python(IN[0]=python_script_2, IN[1]=python_script_check_op_selectie, IN[2]=boolean_2)  # CPython3
# ---------- python_script_3.python (14 lines) ----------
librariescheck = IN[0][0]
subsetcheck = IN[1][0]
subsetpath = IN[1][1]
subsetfilter = IN[2]

if subsetcheck == "geldig" and librariescheck == "geldig":
    from OTL_Propertysets_aanmaken.OTL_data_naar_dict import OTL_to_dict
    OUT = ["geldig", OTL_to_dict(subsetpath,subsetfilter)]
elif subsetcheck == "geldig" and librariescheck != "geldig":
    OUT = ["FOUT","Libraries niet correct ingeladen"]
elif subsetcheck != "geldig" and librariescheck == "geldig":
    OUT = ["FOUT","Geen geldige OTL subset gevonden"]    
else:
    OUT = ["FOUT","obekend"]
# ----------------------------------------

# group: pset def aanmaken
python_script_4 = Python(IN[0]=python_script_3)  # CPython3
# ---------- python_script_4.python (8 lines) ----------
check = IN[0][0]
OTL_psetinfoDict = IN[0][1]

if check == "geldig":
    from OTL_Propertysets_aanmaken.propertysetdefinitions_aanmaken import dict_to_psetdef
    OUT = ["geldig", dict_to_psetdef(check,OTL_psetinfoDict)]   
else:
    OUT = ["FOUT","obekend"]
# ----------------------------------------

# group: Output message
code_block = CodeBlock(Propertyset_Info=python_script_4)
# ---------- code_block.designscript (2 lines) ----------
//aantal aangemaakte propertysets
Propertyset_Info;
# ----------------------------------------
