# Dynamo graph OTL_Pset_by_layermapping.dyn (Dynamo 3.4.1.7055)

# group: Layermapping CSV inlezen
file_path = Filename(".\layermapping.csv")
boolean = BoolSelector(false)
importCSV = Data.ImportCSV(filePath=file_path, transpose=boolean)

# group: Lijstitems selecteren
firstItem = List.FirstItem(list=importCSV)
lastItem = List.LastItem(list=importCSV)

# group: Objecten opvragen in deze layers
current = Autodesk.AutoCAD.DynamoNodes.Document.Current()
modelSpace = Autodesk.AutoCAD.DynamoNodes.Document.ModelSpace(document=current)
all_objects_on_layer = AcObjectsOnLayer(layerName=firstItem, block=modelSpace)

# group: Property set koppelen aan objecten
addPropertySet = Autodesk.AutoCAD.DynamoNodes.Object.AddPropertySet(object=all_objects_on_layer, propertySetDefinitionName=lastItem)
