# Dynamo graph OTL_Select_objects.dyn (Dynamo 2.13.1.3887)

file_path = Filename("testfiles-dwg\validatiefouten-DA-2025-dummy.csv")

# group: Alles in de tekening selecteren
layers = Autodesk.AutoCAD.DynamoNodes.Document.LayerNames()  # "Document.Layers"; frozen; unwired: document
current = Autodesk.AutoCAD.DynamoNodes.Document.Current()
modelSpace = Autodesk.AutoCAD.DynamoNodes.Document.ModelSpace(document=current)

layers_2 = Autodesk.AutoCAD.DynamoNodes.Document.Layers(document=current)

# group (continued): Alles in de tekening selecteren
all_objects_on_layer = AcObjectsOnLayer(layer=layers_2, block=modelSpace)
flatten = List.Flatten(list=all_objects_on_layer)

# group: enkel objecten met OTL psets uitfilteren
propertySets = Autodesk.AutoCAD.DynamoNodes.Object.PropertySets(object=flatten)
name = Autodesk.AutoCAD.DynamoNodes.PropertySet.Name(propertySet=propertySets)
code_block = CodeBlock { "OTL_"; }
startsWith = String.StartsWith(string=name, searchFor=code_block)
boolean = BoolSelector(true)

contains = List.Contains(list=startsWith@L2, item=boolean)

# group (continued): enkel objecten met OTL psets uitfilteren
filterByBoolMask = List.FilterByBoolMask(list=propertySets, mask=contains)

# group: assetIDs ophalen
code_block_2 = CodeBlock { "assetId.identificator"; }
propertyByName = Autodesk.AutoCAD.DynamoNodes.PropertySet.PropertyByName(propertySet=filterByBoolMask.in, name=code_block_2)
value = Autodesk.AutoCAD.DynamoNodes.Property.Value(property=propertyByName)
flatten_2 = List.Flatten(list=value)

# group: assetid-handle- overzicht maken
file_path_2 = Filename(".\output.csv.txt")  # frozen
getItemAtIndex = List.GetItemAtIndex(list=flatten_2)  # frozen; unwired: index
list_create = List.Create(item0=getItemAtIndex)  # unwired: item1
transpose = List.Transpose(lists=list_create)
exportCSV = Data.ExportCSV(filePath=file_path_2, data=transpose)

# group: tekstinput
code_block_3 = CodeBlock { "14aaa032-f3fc-4773-8a69-44434ba5fde4-b25kZXJkZWVsI0RhdGFrYWJlbA"; }

# group: Zoeken op
code_block_4 = CodeBlock { "handle"; "assetId.identificator"; "typeURI"; "rommel"; }

filterByBoolMask_2 = List.FilterByBoolMask(list=flatten, mask=contains)

# group: Handles ophalen
code_block_5 = CodeBlock(o=filterByBoolMask_2.in) { o.Handle; }

# group: TypeURIs ophalen
code_block_6 = CodeBlock { "typeURI"; }
propertyByName_2 = Autodesk.AutoCAD.DynamoNodes.PropertySet.PropertyByName(propertySet=filterByBoolMask.in, name=code_block_6)
value_2 = Autodesk.AutoCAD.DynamoNodes.Property.Value(property=propertyByName_2)
flatten_3 = List.Flatten(list=value_2)

# group: Lijst maken uit CSV en dewe items zoeken in lijst uit file
python_script_geldigheid_csv_en = Python(IN[0]=code_block_3, IN[1]=code_block_4.out3, IN[2]=code_block_5, IN[3]=flatten_2, IN[4]=flatten_3)  # "Python Script: Geldigheid CSV en omzetting waarden naar lijst"; CPython3
# ---------- python_script_geldigheid_csv_en.python (129 lines) ----------
# Load the Python Standard and DesignScript Libraries
import re
import os
import csv
import ctypes
import clr
import random

# Add Assemblies for AutoCAD and Civil3D
clr.AddReference('AcMgd')
clr.AddReference('AcCoreMgd')
clr.AddReference('AcDbMgd')
clr.AddReference('AecBaseMgd')
clr.AddReference('AecPropDataMgd')
clr.AddReference('AeccDbMgd')

# Import references from AutoCAD
from Autodesk.AutoCAD.Runtime import *
from Autodesk.AutoCAD.ApplicationServices import *
from Autodesk.AutoCAD.EditorInput import *
from Autodesk.AutoCAD.DatabaseServices import *
from Autodesk.AutoCAD.Geometry import *
from Autodesk.AutoCAD.Colors import *

# Import references from Civil3D
from Autodesk.Civil.ApplicationServices import *
from Autodesk.Civil.DatabaseServices import *

# Import references for PropertySets
from Autodesk.Aec.PropertyData import *
from Autodesk.Aec.PropertyData.DatabaseServices import *

# Import references for ListDefinitions
from Autodesk.Aec.DatabaseServices import ListDefinition, ListItem, DictionaryListDefinition

adoc = Application.DocumentManager.MdiActiveDocument
editor = adoc.Editor

#INPUT
inputveld = IN[0]
hoofdingfilter = IN[1]
dwg_objecten_handles = IN[2]
dwg_objecten_ids = IN[3]
dwg_objecten_typeURIs = IN[4]

foutgevonden = 0
message = ""
m = ctypes.windll.user32
nl = '\n'
    
#CSV inlezen en items eruit zoeken in lijst van OTL items in dwg

objectenlijst = []
filecount = 0
filter_oke = 1
te_selecteren_handles = []
handlezoeker = 0

if inputveld:
    if hoofdingfilter == "typeURI":
        message = "assets worden gezocht obv typeURI"
        zoeklijst = dwg_objecten_typeURIs                    
    elif hoofdingfilter == "assetId.identificator":
        message = "assets worden gezocht obv assetId.identificator"
        zoeklijst = dwg_objecten_ids                 
    elif hoofdingfilter == "handle":
        message = "assets worden gezocht obv handle"
        zoeklijst = dwg_objecten_handles
        handlezoeker = 1
    else:
        message = f"Geen correcte filter, je kan assets zoeken op een van de volgende: {nl}typeURI{nl}assetId.identificator{nl}handle{nl}"
        zoeklijst = []
        filter_oke = 0
        
    if inputveld.endswith(".csv"):
        filedir = inputveld
        try:
            with open(filedir, encoding='utf-8') as csvfile:
                ingelezen_csv = csv.DictReader(csvfile, delimiter=";")
                csv_dicts = (list(ingelezen_csv))
                #check of filter bruikbaar is


        except Exception as e:
            message = f"Kon CSV bestand niet openen: {nl}{str(inputveld)}{e}"
        
        if filter_oke:
            for d in csv_dicts:
                if hoofdingfilter in d:#check of key bestaat
                    if d[hoofdingfilter]:#check of er een waarde is voor deze key
                        objectenlijst.append(d[hoofdingfilter])
                else:
                    message = "Kon de opgegeven hoofding niet terugvinden in de csv file"
            if len(objectenlijst) == 0:
                message = "Geen waarden gevonden in de opgegeven hoofding"
            
    else:#indien er een waarde werd opgegeven ipv een csv
        objectenlijst = [inputveld]
        
    ongevonden_waardes = []
    for o in objectenlijst:
        if handlezoeker:#handles in caps omzetten
            o = o.upper()
            
        if zoeklijst:
            if o in zoeklijst:
                #meerdere indices mogelijk, bv bij donut polygons    
                indices = [i for i, x in enumerate(zoeklijst) if x == o]
                for i in indices:
                    te_selecteren_handles.append(dwg_objecten_handles[i])
                
            else:
                ongevonden_waardes.append(o)
                
            if len(ongevonden_waardes) > 0:
                message = f"Kon volgende waardes niet vinden in dwg file:{nl}{nl.join(ongevonden_waardes)}"
        
else:
    foutgevonden = 1
    if message == "":
        message = f"Geen input: Voer een waarde of een csv file met waardes in"


if message:
    m.MessageBoxW(0, str(message), "OTL Select Objects", 0)

# OUT variable.
OUT = te_selecteren_handles
    
# ----------------------------------------

# group: Selecteer de objecten in de dwg
python_script = Python(IN[0]=python_script_geldigheid_csv_en)  # CPython3
# ---------- python_script.python (35 lines) ----------
# Load the Python Standard and DesignScript Libraries
import sys
import clr

# Add Assemblies for AutoCAD and Civil3D
clr.AddReference('AcMgd')
clr.AddReference('AcCoreMgd')
clr.AddReference('AcDbMgd')
clr.AddReference('AecBaseMgd')
clr.AddReference('AecPropDataMgd')
clr.AddReference('AeccDbMgd')

# Import references from AutoCAD
from Autodesk.AutoCAD.Runtime import *
from Autodesk.AutoCAD.ApplicationServices import *
from Autodesk.AutoCAD.EditorInput import *
from Autodesk.AutoCAD.DatabaseServices import *
from Autodesk.AutoCAD.Geometry import *

# Import references from Civil3D
from Autodesk.Civil.ApplicationServices import *
from Autodesk.Civil.DatabaseServices import *


input = 'SELECT' + '\n' + 'none' + '\n' + 'SELECT' + '\n' 
for x in IN[0]:
    input = input + '(handent"' + x + '")' + '\n'
adoc = Application.DocumentManager.MdiActiveDocument
adoc.SendStringToExecute(input, True, False, False)
input = '\n'
adoc.SendStringToExecute(input, True, False, False)
input = 'ISOLATE' + '\n'
adoc.SendStringToExecute(input, True, False, False)
# Assign your output to the OUT variable.
OUT = input + " sent to command line"
# ----------------------------------------

code_block_7 = CodeBlock { -nog een bericht voorzien als het klaar is; bekijk de ge-isoleerde files in de dwg en hoe te un-isolaten; }
code_block_8 = CodeBlock(o=flatten) { o.Handle; }
